# Dynamo graph Levantamiento_a_Revit.dyn "Levantamiento a Revit" (Dynamo 3.0.3.7597)
# author: Jose Miguel Santibáñez
# Crea muros, puertas, ventanas, vanos y habitaciones desde la app de levantamiento

n1_archivo__revit_json_del = Filename("")  # "1) Archivo _revit.json del levantamiento"
n2_nivel_de_revit_para_el_0_00 = StringInput("")  # "2) Nivel de Revit para el ±0,00 (vacío = el más bajo)"
n3_familia_de_puertas_contiene = StringInput("")  # "3) Familia de puertas contiene… (opcional)"
n4_familia_de_ventanas_contiene = StringInput("")  # "4) Familia de ventanas contiene… (opcional)"
n5_familia_de_pilares_contiene = StringInput("")  # "5) Familia de pilares contiene… (opcional)"
levantamiento_a_revit = Python(IN[0]=n1_archivo__revit_json_del, IN[1]=n2_nivel_de_revit_para_el_0_00, IN[2]=n3_familia_de_puertas_contiene, IN[3]=n4_familia_de_ventanas_contiene, IN[4]=n5_familia_de_pilares_contiene)  # CPython3
# ---------- levantamiento_a_revit.python (350 lines) ----------
# -*- coding: utf-8 -*-
"""
Levantamiento -> Revit  (Dynamo 3.x, motor CPython3 — Revit 2025)

Lee el archivo "..._revit.json" que exporta la app de levantamiento. El ±0,00 del levantamiento se
ubica en el nivel más bajo del modelo (o en el nivel indicado en IN[1]); cada nivel del levantamiento
usa el nivel de Revit que esté a su cota (NPT) o se crea uno nuevo con su vista de planta. En cada nivel crea:
  - Tipos de muro "Levantamiento NN cm" (una capa, según espesor) y muros nativos por su eje, con su altura.
  - Puertas, ventanas y ventanales: duplica un tipo de la familia cargada con el ancho y alto medidos.
  - Vanos vacíos: aberturas rectangulares en el muro.
  - Habitaciones con el nombre y la altura de cada recinto.
  - Pilares: columnas estructurales (o arquitectónicas si no hay) con su sección, altura y giro.
  - Ejes de referencia como Rejillas (Grids) con su nombre (una sola vez aunque se repitan en varios niveles).

Entradas:
  IN[0]  ruta del archivo .json (nodo File Path)
  IN[1]  (opcional) nombre del nivel de Revit que corresponde al ±0,00. Vacío = nivel más bajo
  IN[2]  (opcional) texto que contenga el nombre de la familia de puertas a usar
  IN[3]  (opcional) texto que contenga el nombre de la familia de ventanas a usar
  IN[4]  (opcional) texto que contenga el nombre de la familia de pilares a usar
Ejecutar UNA sola vez en modo Manual: cada ejecución vuelve a crear los elementos.
"""
import clr, json, math
clr.AddReference('RevitAPI')
from Autodesk.Revit.DB import *
from Autodesk.Revit.DB.Structure import StructuralType
clr.AddReference('RevitServices')
from RevitServices.Persistence import DocumentManager
from RevitServices.Transactions import TransactionManager

doc = DocumentManager.Instance.CurrentDBDocument

def _in(i, default=None):
    try:
        v = IN[i]
        return v if v not in (None, '') else default
    except Exception:
        return default

path = _in(0)
level_name = _in(1)
door_hint = (_in(2) or '').lower()
win_hint = (_in(3) or '').lower()
col_hint = (_in(4) or '').lower()

FT = 1.0 / 0.3048
def ft(m): return float(m) * FT

report = []

def type_name(e):
    p = e.get_Parameter(BuiltInParameter.SYMBOL_NAME_PARAM)
    return p.AsString() if p else ''

def family_name(sym):
    try:
        return sym.Family.Name
    except Exception:
        p = sym.get_Parameter(BuiltInParameter.SYMBOL_FAMILY_NAME_PARAM)
        return p.AsString() if p else ''

import os
if not path or not os.path.isfile(str(path)):
    raise Exception('Primero elige el archivo _revit.json en el nodo 1) con "Examinar..." y vuelve a ejecutar.')
with open(path, encoding='utf-8') as f:
    data = json.load(f)

# ---------- niveles ----------
rv_levels = sorted(FilteredElementCollector(doc).OfClass(Level).ToElements(), key=lambda l: l.Elevation)
base = rv_levels[0]
if level_name:
    for l in rv_levels:
        if l.Name == level_name:
            base = l
base_z = base.Elevation      # pies; corresponde al ±0,00 del levantamiento

# archivos antiguos (un solo nivel) -> mismo formato que los nuevos
if 'levels' not in data:
    data['levels'] = [{'name': 'Nivel 1', 'elevation': 0.0, 'walls': data.get('walls', []),
                       'openings': data.get('openings', []), 'rooms': data.get('rooms', [])}]

plan_vft = None
for vft in FilteredElementCollector(doc).OfClass(ViewFamilyType).ToElements():
    if vft.ViewFamily == ViewFamily.FloorPlan:
        plan_vft = vft
        break

def level_for(lv):
    z = base_z + ft(lv.get('elevation', 0))
    for l in FilteredElementCollector(doc).OfClass(Level).ToElements():
        if abs(l.Elevation - z) < 0.01:          # ~3 mm
            return l, False
    nl = Level.Create(doc, z)
    try:
        nl.Name = lv.get('name') or nl.Name
    except Exception:
        try:
            nl.Name = '%s (levantamiento)' % lv.get('name')
        except Exception:
            pass
    if plan_vft is not None:
        try:
            vp = ViewPlan.Create(doc, plan_vft.Id, nl.Id)
            try:
                vp.Name = nl.Name
            except Exception:
                pass
        except Exception:
            pass
    return nl, True

# ---------- tipos de muro ----------
basic_types = [t for t in FilteredElementCollector(doc).OfClass(WallType).ToElements() if t.Kind == WallKind.Basic]
wall_types = {}
def wall_type(thk):
    cm = int(round(thk * 100))
    if cm in wall_types:
        return wall_types[cm]
    name = 'Levantamiento %d cm' % cm
    for t in basic_types:
        if type_name(t) == name:
            wall_types[cm] = t
            return t
    nt = doc.GetElement(basic_types[0].Duplicate(name).Id)
    cs = CompoundStructure.CreateSingleLayerCompoundStructure(MaterialFunctionAssignment.Structure, ft(thk), ElementId.InvalidElementId)
    nt.SetCompoundStructure(cs)
    wall_types[cm] = nt
    report.append('Tipo de muro creado: ' + name)
    return nt

# ---------- tipos de puerta / ventana ----------
def symbols(cat, hint):
    syms = list(FilteredElementCollector(doc).OfClass(FamilySymbol).OfCategory(cat).ToElements())
    if hint:
        pref = [s for s in syms if hint in family_name(s).lower()]
        if pref:
            return pref
    return syms

def set_len(elem, names, bips, value):
    for b in bips:
        bip = getattr(BuiltInParameter, b, None)
        if bip is None:
            continue
        p = elem.get_Parameter(bip)
        if p and not p.IsReadOnly:
            p.Set(value)
            return True
    for n in names:
        p = elem.LookupParameter(n)
        if p and not p.IsReadOnly and p.StorageType == StorageType.Double:
            p.Set(value)
            return True
    return False

sym_cache = {}
def symbol_for(kind, w, h):
    cat = BuiltInCategory.OST_Doors if kind == 'door' else BuiltInCategory.OST_Windows
    hint = door_hint if kind == 'door' else win_hint
    base_list = symbols(cat, hint)
    if not base_list:
        return None
    base = base_list[0]
    fam = family_name(base)
    name = '%s %dx%d' % ('Lev', int(round(w * 100)), int(round(h * 100)))
    key = (fam, name)
    if key in sym_cache:
        return sym_cache[key]
    for s in base_list:
        if family_name(s) == fam and type_name(s) == name:
            sym_cache[key] = s
            return s
    ns = doc.GetElement(base.Duplicate(name).Id)
    okw = set_len(ns, ['Width', 'Anchura', 'Ancho'], ['DOOR_WIDTH', 'WINDOW_WIDTH', 'FAMILY_WIDTH_PARAM'], ft(w))
    okh = set_len(ns, ['Height', 'Altura', 'Alto'], ['DOOR_HEIGHT', 'WINDOW_HEIGHT', 'FAMILY_HEIGHT_PARAM'], ft(h))
    if not (okw and okh):
        report.append('Aviso: no se pudo fijar ancho/alto en la familia "%s"; revisa el tipo %s' % (fam, name))
    if not ns.IsActive:
        ns.Activate()
    sym_cache[key] = ns
    return ns

col_cache = {}
def column_symbol(w, d):
    # primero columnas estructurales; si no hay cargadas, columnas arquitectónicas
    for cat, structural in ((BuiltInCategory.OST_StructuralColumns, True), (BuiltInCategory.OST_Columns, False)):
        base_list = symbols(cat, col_hint)
        if not base_list:
            continue
        base = base_list[0]; fam = family_name(base)
        name = 'Lev %dx%d' % (int(round(w * 100)), int(round(d * 100)))
        key = (fam, name)
        if key in col_cache:
            return col_cache[key], structural
        for s_ in base_list:
            if family_name(s_) == fam and type_name(s_) == name:
                col_cache[key] = s_
                return s_, structural
        ns = doc.GetElement(base.Duplicate(name).Id)
        okw = set_len(ns, ['b', 'Width', 'Anchura', 'Ancho'], [], ft(w))
        okd = set_len(ns, ['h', 'Depth', 'Profundidad', 'Fondo', 'Largo'], [], ft(d))
        if not (okw and okd):
            report.append('Aviso: no se pudo fijar la sección en la familia de pilares "%s"; revisa el tipo %s' % (fam, name))
        if not ns.IsActive:
            ns.Activate()
        col_cache[key] = ns
        return ns, structural
    return None, False

# ---------- crear ----------
TransactionManager.Instance.EnsureInTransaction(doc)

grid_names = set()
for g_ in FilteredElementCollector(doc).OfClass(Grid).ToElements():
    try:
        grid_names.add(g_.Name)
    except Exception:
        pass
n_grids = 0
for lv in data['levels']:
    for gr in lv.get('grids', []):
        if gr['name'] in grid_names:
            continue
        try:
            a = XYZ(ft(gr['start'][0]), ft(gr['start'][1]), base_z); b = XYZ(ft(gr['end'][0]), ft(gr['end'][1]), base_z)
            if a.DistanceTo(b) < 0.01:
                continue
            gg = Grid.Create(doc, Line.CreateBound(a, b))
            try:
                gg.Name = gr['name']
            except Exception:
                report.append('Aviso: no se pudo nombrar el eje %s (¿nombre repetido?)' % gr['name'])
            grid_names.add(gr['name']); n_grids += 1
        except Exception as ex:
            report.append('Error en eje %s: %s' % (gr.get('name'), ex))
if n_grids:
    report.append('Ejes (rejillas) creados: %d' % n_grids)

for lv in data['levels']:
    level, created = level_for(lv)
    z0 = level.Elevation
    report.append('— %s → nivel Revit "%s"%s (NPT %+.2f m)' % (lv.get('name'), level.Name, ' (nuevo)' if created else '', float(lv.get('elevation', 0))))
    if not lv.get('rectified', True):
        report.append('  Aviso: este nivel no estaba rectificado; las medidas pueden no ser a escala.')

    def P3(x, y, z=0.0):
        return XYZ(ft(x), ft(y), z0 + ft(z))

    walls = {}
    for w in lv.get('walls', []):
        try:
            a = P3(w['start'][0], w['start'][1]); b = P3(w['end'][0], w['end'][1])
            if a.DistanceTo(b) < 0.01:
                continue
            wt = wall_type(float(w['thickness']))
            wall = Wall.Create(doc, Line.CreateBound(a, b), wt.Id, level.Id, ft(w['height']), 0.0, False, False)
            c = wall.get_Parameter(BuiltInParameter.ALL_MODEL_INSTANCE_COMMENTS)
            if c:
                c.Set('%s %s (levantamiento)' % (lv.get('name'), w['name']))
            walls[w['id']] = (wall, a, b)
        except Exception as ex:
            report.append('  Error en muro %s: %s' % (w.get('name'), ex))
    doc.Regenerate()

    n_inst = 0; n_open = 0
    for o in lv.get('openings', []):
        try:
            if o['wall'] not in walls:
                continue
            wall, a, b = walls[o['wall']]
            d = b.Subtract(a).Normalize()
            c = a.Add(d.Multiply(ft(o['center'])))
            width = float(o['width']); height = float(o['height']); sill = float(o.get('sill', 0) or 0)
            if o['kind'] == 'opening':
                p1 = c.Subtract(d.Multiply(ft(width / 2))).Add(XYZ(0, 0, ft(sill)))
                p2 = c.Add(d.Multiply(ft(width / 2))).Add(XYZ(0, 0, ft(sill + height)))
                doc.Create.NewOpening(wall, p1, p2)
                n_open += 1
                continue
            kind = 'door' if o['kind'] == 'door' else 'window'
            sym = symbol_for(kind, width, height)
            if sym is None:
                report.append('  No hay familias de %s cargadas: se omitió %s' % ('puertas' if kind == 'door' else 'ventanas', o['name']))
                continue
            doc.Regenerate()
            inst = doc.Create.NewFamilyInstance(XYZ(c.X, c.Y, z0), sym, wall, level, StructuralType.NonStructural)
            if kind == 'window':
                p = inst.get_Parameter(BuiltInParameter.INSTANCE_SILL_HEIGHT_PARAM)
                if p and not p.IsReadOnly:
                    p.Set(ft(sill))
            else:
                fl = int(o.get('flip', 0))
                try:
                    if fl & 1: inst.flipHand()
                    if fl & 2: inst.flipFacing()
                except Exception:
                    pass
            m = inst.get_Parameter(BuiltInParameter.ALL_MODEL_MARK)
            if m:
                m.Set(o['name'])
            n_inst += 1
        except Exception as ex:
            report.append('  Error en vano %s: %s' % (o.get('name'), ex))

    doc.Regenerate()
    n_rooms = 0
    for r in lv.get('rooms', []):
        try:
            room = doc.Create.NewRoom(level, UV(ft(r['at'][0]), ft(r['at'][1])))
            p = room.get_Parameter(BuiltInParameter.ROOM_NAME)
            if p:
                p.Set(r['name'])
            if r.get('height'):
                up = room.get_Parameter(BuiltInParameter.ROOM_UPPER_OFFSET)
                if up:
                    up.Set(ft(r['height']))
            n_rooms += 1
        except Exception as ex:
            report.append('  Habitación "%s" no creada: %s' % (r.get('name'), ex))
    n_cols = 0
    for c in lv.get('columns', []):
        try:
            sym, structural = column_symbol(float(c['width']), float(c['depth']))
            if sym is None:
                report.append('  No hay familias de pilares cargadas: se omitió %s' % c['name'])
                continue
            doc.Regenerate()
            pt = P3(c['center'][0], c['center'][1])
            inst = doc.Create.NewFamilyInstance(pt, sym, level, StructuralType.Column if structural else StructuralType.NonStructural)
            top = inst.get_Parameter(BuiltInParameter.FAMILY_TOP_LEVEL_PARAM)
            if top and not top.IsReadOnly:
                top.Set(level.Id)
            off = inst.get_Parameter(BuiltInParameter.FAMILY_TOP_LEVEL_OFFSET_PARAM)
            if off and not off.IsReadOnly:
                off.Set(ft(c['height']))
            rot = float(c.get('rotation', 0) or 0)
            if abs(rot) > 0.01:
                axis = Line.CreateBound(pt, XYZ(pt.X, pt.Y, pt.Z + 1))
                ElementTransformUtils.RotateElement(doc, inst.Id, axis, math.radians(rot))
            m = inst.get_Parameter(BuiltInParameter.ALL_MODEL_MARK)
            if m:
                m.Set(c['name'])
            n_cols += 1
        except Exception as ex:
            report.append('  Error en pilar %s: %s' % (c.get('name'), ex))
    report.append('  Muros: %d · Puertas y ventanas: %d · Vanos: %d · Pilares: %d · Habitaciones: %d' % (len(walls), n_inst, n_open, n_cols, n_rooms))

TransactionManager.Instance.TransactionTaskDone()

OUT = report
# ----------------------------------------
